# Grasshopper definition Appserver1.gh (Grasshopper 1.0.7)
# plug-ins: Bifocals

# HOUSE POSITION
number_slider = Slider(8, range=8..20)

# ---- group: Size of panel(cm)
number_slider_2 = Slider(122, range=0..122)
number_slider_3 = Slider(0, range=0..20)

# ----
no_of_panels_2 = GetInteger(Slider(8, range=8..20), AtLeast=1, AtMost=2147483647, Maximum=359, Minimum=0)
no_of_panels_1 = GetInteger(number_slider, AtLeast=1, AtMost=2147483647, Maximum=359, Minimum=0)
series = Series(Start=number_slider_3, Step=number_slider_2, Count=no_of_panels_1)
# 4. Daylight Autonomy
# 6. Annual Sunlight Exposure
series_2 = Series(Start=number_slider_3, Step=number_slider_2, Count=no_of_panels_2)
sort = SortList(Keys=series_2)  # -> Keys, ValuesA
sort_2 = SortList(Keys=series)  # -> Keys, ValuesA
rev = ReverseList(List=sort.Keys)
rev_2 = ReverseList(List=sort_2.Keys)
item = ListItem(List=rev, Index=0, Wrap=True)
item_2 = ListItem(List=rev_2, Index=0, Wrap=True)
pt = Point(Point(1170, 3493, 0))
division = Division(A=item, B=2)
division_2 = Division(A=item_2, B=2)
box = CenterBox(Base=pt, X=division, Y=division_2, Z="150")
pdecon = Deconstruct(Point=pt)  # -> XComponent, YComponent, ZComponent
Z = UnitZ(Factor="150")
pt_2 = ConstructPoint(XCoordinate=pdecon.XComponent, YCoordinate=pdecon.YComponent, ZCoordinate=0)
move = Move(Geometry=box, Motion=Z)  # -> Geometry, Transform
rotation = GetInteger(Slider(0, range=0..359), AtLeast=1, AtMost=2147483647, Maximum=359, Minimum=0)
rotate = Rotate(Geometry=move.Geometry, Angle=degrees(rotation), Plane=pt_2)  # -> Geometry, Transform
debrep = DeconstructBrep(Brep=rotate.Geometry)  # -> Faces, Edges, Vertices
area = Area(Geometry=debrep.Faces)  # -> Area, Centroid
pdecon_2 = Deconstruct(Point=area.Centroid)  # -> XComponent, YComponent, ZComponent
sort_3 = SortList(Keys=pdecon_2.ZComponent)  # -> Keys, ValuesA
rev_3 = ReverseList(List=sort_3.Keys)
item_3 = ListItem(List=rev_3, Index=0, Wrap=True)
larger = LargerThan(FirstNumber=pdecon_2.ZComponent, SecondNumber=item_3)  # -> LargerThan, OrEqualTo
dispatch = Dispatch(List=debrep.Faces, DispatchPattern=larger.OrEqualTo)  # -> ListA, ListB
# 5. Point-in-time Illuminance
# sDA - no blinds
# (Spatial Daylight Autonomy)
# ASE
dispatch_2 = Dispatch(List=area.Centroid, DispatchPattern=larger.OrEqualTo)  # -> ListA, ListB
scale = Scale(Geometry=dispatch.ListA, Center=dispatch_2.ListA, Factor="1.1")  # -> Geometry, Transform
# Illuminance
Z_2 = UnitZ(Factor="50")
extr = Extrude(Base=scale.Geometry, Direction=Z_2)

# ---- group: RH_OUT:walls
# TITLE
# GENERATIVE OUTPUT
# ERROR
# Important toggle
# QUESTION
# NOTE
# OUTPUT
# INPUT
final_geometry = Geometry(rotate.Geometry)

# ---- group: RH_OUT:Roof_base
# sDA
# DA
# ASE
# ASE
custom_preview = CustomPreview(
    Geometry=extr,
    Material={diffuse=RGB(221, 160, 221), emission=RGB(66, 48, 66), shine=0.5, specular=RGB(255, 255, 255), transparency=0})
